# Dynamo custom node RevitExecutablePath.ByVersion.dyf (Dynamo 0.8.3.2580)
# category: DynamoAutomation.FilePath.Create
# Returns the path of Revit.exe based on a given Revit version

RevitVersion = Input(RevitVersion : string = "2016")
code_block = CodeBlock(RevitVersion=RevitVersion) { "C:\Program Files\Autodesk\Revit " + RevitVersion + "\\Revit.exe"; }
Revit_exe_Path = Output(code_block)  # "Revit.exe Path"
