# Dynamo graph A1 - Sandbox.dyn (Dynamo 0.8.3.2535)

# group: INPUTS
directory_path_journal_files = Directory("C:\Users\adieckmann\Desktop")
overwrite_existing_journal_files = BoolSelector(true)
directory_path_revit_models = Directory("C:\Users\adieckmann\Documents\GitHub\DynamoAutomation\revit-models\2016\dir1")
file_path_dynamo_file = Filename("C:\Users\adieckmann\Documents\GitHub\DynamoAutomation\scenarios\Revit\2016\CountWalls.dyn")
revit_version = StringInput("2016")

# group: Create list of Revit files
fromPath = DirectoryObject(directory_path_revit_models)  # "Directory.FromPath"
code_block = CodeBlock { "*.rvt"; }
contents = Directory.Contents(fromPath, code_block)

# group: Create journal files
byVersion = Custom[RevitAddinsPath.ByVersion](RevitVersion=revit_version)  # Returns the path of Revit Addins folder based on a given Revit version
string = StringInput("\")
count = List.Count(contents)
code_block_2 = CodeBlock(n=count) { 1..n; }
string_from_object = FromObject(code_block_2)
code_block_3 = CodeBlock(jdir=byVersion, delimiter=string, n=string_from_object)
# ---------- code_block_3.designscript (2 lines) ----------
// Create file name for journal file
jdir + delimiter + "DynamoJournalFile_" + n + ".txt";
# ----------------------------------------
byWorkspacePath = Dynamo.Automation.Journal.ByWorkspacePath(contents, file_path_dynamo_file, code_block_3)

# group: Batch-process Revit files
code_block_4 = CodeBlock(jpath=byWorkspacePath)
# ---------- code_block_4.designscript (7 lines) ----------
// You'll need an English language version of Revit
// in order to run the journals.
// If that is your default language
// you won't need this code block.
// This is what needs to appended to the exectuable path for Revit 2016.
// It may be different for Revit 2015.
" /language ENU " + jpath;
# ----------------------------------------
byVersion_2 = Custom[RevitExecutablePath.ByVersion](RevitVersion=revit_version)  # Returns the path of Revit.exe based on a given Revit version
byPathAndArguments = Dynamo.Automation.Process.ByPathAndArguments(byVersion_2)
map = List.Map(list=code_block_4, f_x=byPathAndArguments)
cleanup = Custom[JournalFiles.Cleanup](destinationDirectory=directory_path_journal_files, overwriteExistingFiles=overwrite_existing_journal_files, executionDone=map, generatedJournalFiles=byWorkspacePath)  # Moves all journal files created during a batch-processing operation to a specified directory
